# Dynamo graph CreateRevitLevels.dyn (Dynamo 2.19.0.0)
# Creates Revit Levels from a list of names and elevations (in millimetres) using DesignScript.

elevations_mm = CodeBlock { [0, 3000, 6000, 9000, 12000]; }  # graph input
# note: 1  Edit Level Names and Elevations (mm)
# 2  Click Run  -  levels appear in Revit immediately
level_names = CodeBlock { ["Ground Floor", "Level 1", "Level 2", "Level 3", "Roof"]; }  # graph input
create_revit_levels = CodeBlock(elevations_mm=elevations_mm, names=level_names) { levels = Revit.Elements.Level.ByElevation(elevations_mm / 1000.0); named = levels.SetParameterByName("Name", names); }
result = Watch(create_revit_levels.named)
